# Grasshopper definition testGHCS.gh (Grasshopper 1.0.7)

# ----
# 1. corresponds to python  var dirpath
panel = Panel("c:\xyz")

# ----
# 2. corresponds to python  var outfilename
panel_2 = Panel("abc.txt")

# ----
# your choice of python interpreter
panel_3 = Panel("C:\Users\Nirvik Saha\AppData\Local\Programs\Python\Python38\python.exe")

# ----
# the python file to be executed
panel_4 = Panel("test.py")

ifcjsonteam = CSharpScript(PyFileNameToExec=panel_4, DirPath=panel, PythonEXEPath=panel_3, outputFileName=panel_2)  # -> out, A, B; inputs PyFileNameToExec: String, DirPath: String, PythonEXEPath: String
# ---------- ifcjsonteam: C# usings ----------
using System.Diagnostics;
using System.IO;
# ---------- ifcjsonteam: C# ----------
    DirectoryInfo d = new DirectoryInfo(DirPath);
    FileInfo[] Files = d.GetFiles("*");
    string str = "";
    foreach (FileInfo file in Files)
    {
      str = str + ", " + file.Name;
    }
    Print(str);

    string filePath = DirPath + @"\" + PyFileNameToExec;
    Process p = new Process();
    p.StartInfo = new ProcessStartInfo(PythonEXEPath, filePath)
      {
        RedirectStandardOutput = true,
        UseShellExecute = false,
        CreateNoWindow = false
        };
    p.Start();

    string output = p.StandardOutput.ReadToEnd();
    B = output;

    p.WaitForExit();
    try{
      StreamReader file2 = new StreamReader(DirPath + @"\abc.txt"); // USER - SET CORRESPONDING OUTPUT FILENAME IN PYTHON
      string outputFileContents = "";
      string line = "";
      while((line = file2.ReadLine()) != null)
      {
        outputFileContents += line;
      }
      A = outputFileContents;
      file2.Close();
    }catch(Exception){
      A = "process failed...";
    }
# ---------- end ifcjsonteam ----------

# ----
# check the dir files (debugging)
panel_5 = Panel(ifcjsonteam.out)

# ----
# reads the content generated from python script and written to a file (optional)
panel_6 = Panel(ifcjsonteam.A)

# ----
# reads the print from python script  (optional)
panel_7 = Panel(ifcjsonteam.B)
